# Grasshopper definition Problem1-3.gh (Grasshopper 0.9.76)
# plug-ins: GHEnergyPlus

# ---- group: run EnergyPlus
# BEO Problems 1 - 3
toggle = BooleanToggle(False)

# ---- group: Choose Input folder index
panel = Panel("0")

# ---- group: Replace this with your optimizer
galapagos = Galapagos(fitness=wettersimplepara, gene=[number_slider_2, number_slider_3, number_slider_4, number_slider])

# ---- group: P1: Seattle // P2: Houston // P3: Chicago
list = ValueList({"Chicago": 0, "Houston": 1, "Seattle": 2}, selected="Seattle")

# ---- group: parameters
number_slider = Slider(0.538, range=0.2..0.8)
number_slider_2 = Slider(80.3, range=-180..180)
number_slider_3 = Slider(5.9, range=0.1..5.9)
number_slider_4 = Slider(5.9, range=0.1..5.9)

# ----
templates_idf = Panel("""simple_chicago_template
simple_houston_template
simple_seattle_template""")
weather_files = Panel("""USA_IL_Chicago-OHare.725300_TMY2
USA_TX_Houston-Intercontinental.722430_TMY2
USA_WA_Seattle-Tacoma.727930_TMY2""")
item = ListItem(List=templates_idf, Index=list, Wrap=False)
item_2 = ListItem(List=weather_files, Index=list, Wrap=False)
wettersimplepara = WetterSimplePara(
    Idf=item,
    Weather=item_2,
    Run=toggle,
    Orientation=number_slider_2,
    WindowLW=number_slider_3,
    WindowLE=number_slider_4,
    Transmittance=number_slider,
    Folder=panel)
f_x = Panel(wettersimplepara)
