# Grasshopper definition Problem10.gh (Grasshopper 0.9.76)
# plug-ins: GHEnergyPlus

# ---- group: run EnergyPlus
# BEO Problem 10
toggle = BooleanToggle(False)

# ---- group: Choose Input folder index
panel = Panel("0")

# ---- group: Replace this with your optimizer
galapagos = Galapagos(
    fitness=prob10kämpf,
    gene=[number_slider, number_slider_8, number_slider_9, number_slider_10, number_slider_2, number_slider_3, number_slider_4, number_slider_11, number_slider_5, number_slider_12, number_slider_6, number_slider_7, number_slider_13])

# ----
templates_idf = Panel("problem_10_template")
weather_files = Panel("USA_CA_San.Francisco.Intl.AP_TMY3")

# ---- group: Parameters
number_slider = Slider(1, range=0.8..1.25)
number_slider_2 = Slider(0.8, range=0.8..1.25)
number_slider_3 = Slider(1.35, range=1.35..2.2)
number_slider_4 = Slider(0.8, range=0.8..1.25)
number_slider_5 = Slider(12, range=12..18)
number_slider_6 = Slider(13, range=13..21)
number_slider_7 = Slider(24, range=24..36)
number_slider_8 = Slider(1.35, range=1.35..2.2)
number_slider_9 = Slider(0.8, range=0.8..1.25)
number_slider_10 = Slider(1.35, range=1.35..2.2)
number_slider_11 = Slider(1.35, range=1.35..2.2)
number_slider_12 = Slider(13, range=13..21)
number_slider_13 = Slider(24, range=24..36)

# ----
list = ValueList({"San Francisco": 0}, selected="San Francisco")
item = ListItem(List=templates_idf, Index=list, Wrap=False)
item_2 = ListItem(List=weather_files, Index=list, Wrap=False)
prob10kämpf = Prob10Kämpf(
    Idf=item,
    Weather=item_2,
    Run=toggle,
    Folder=panel,
    N_win_low=number_slider,
    N_win_up=number_slider_8,
    E_win_low=number_slider_9,
    E_win_up=number_slider_10,
    S_win_low=number_slider_2,
    S_win_up=number_slider_3,
    W_win_low=number_slider_4,
    W_win_up=number_slider_11,
    CoolSup=number_slider_5,
    HeatSB_1=number_slider_12,
    HeatSB_2=number_slider_6,
    CoolSB_1=number_slider_7,
    CoolSB_2=number_slider_13)
f_x = Panel(prob10kämpf)
