# Grasshopper definition Problem11.gh (Grasshopper 0.9.76)
# plug-ins: GHEnergyPlus

# ---- group: run EnergyPlus
# BEO Problem 11
toggle = BooleanToggle(False)

# ---- group: Choose Input folder index
panel = Panel("0")

# ---- group: Replace this with your optimizer
galapagos = Galapagos(
    fitness=prob11a_nv,
    gene=[number_slider, number_slider_2, number_slider_3, number_slider_4, number_slider_5, number_slider_6, number_slider_7, number_slider_8, number_slider_9, number_slider_10, number_slider_11, number_slider_12, number_slider_13, number_slider_14, number_slider_15, number_slider_16, number_slider_17, number_slider_18])

# ---- group: Continuous parameters
number_slider = Slider(0, range=-90..90)
number_slider_2 = Slider(9.13, range=4..10)
number_slider_3 = Slider(0.65, range=0.2..0.8)
number_slider_4 = Slider(0.35, range=0.2..0.8)
number_slider_5 = Slider(0.8, range=0.2..0.8)
number_slider_6 = Slider(0.8, range=0.2..0.8)
number_slider_7 = Slider(8, range=5..8)
number_slider_8 = Slider(5, range=5..8)
number_slider_9 = Slider(0.5, range=0.5..2.5)
number_slider_10 = Slider(0.5, range=0.5..2.5)
number_slider_11 = Slider(0.3, range=0.3..0.9)
number_slider_12 = Slider(0.002, range=0.002..0.006)

# ---- group: Categorical parameters
number_slider_13 = Slider(600, range=600..602)
number_slider_14 = Slider(500, range=500..502)
number_slider_15 = Slider(408, range=404..409)
number_slider_16 = Slider(302, range=300..302)
number_slider_17 = Slider(200, range=200..202)
number_slider_18 = Slider(103, range=100..103)

# ----
templates_idf = Panel("HN_NV_Adaptive_template")
weather_files = Panel("VNM_Hanoi.488200_IWEC")
list = ValueList({"Hanoi": 0}, selected="Hanoi")
item = ListItem(List=templates_idf, Index=list, Wrap=False)
item_2 = ListItem(List=weather_files, Index=list, Wrap=False)
prob11a_nv = Prob11NguyenA_NV(
    Idf=item,
    Weather=item_2,
    Run=toggle,
    Folder=panel,
    Azimuth=number_slider,
    Width=number_slider_2,
    Osize1=number_slider_3,
    Osize2=number_slider_4,
    Osize3=number_slider_5,
    Osize4=number_slider_6,
    Wwidth1=number_slider_7,
    Wwidth2=number_slider_8,
    Wwidth3=number_slider_9,
    Wwidth4=number_slider_10,
    Absor=number_slider_11,
    Infil=number_slider_12,
    Tmass=number_slider_13,
    Floortype=number_slider_14,
    Ventilation=number_slider_15,
    Rooftype=number_slider_16,
    Wintype=number_slider_17,
    Exwall=number_slider_18)  # -> TotCost, ConstCost, THDC
f_x = Panel(prob11a_nv.TotCost)
