# Grasshopper definition Problem14.gh (Grasshopper 0.9.76)
# plug-ins: GHEnergyPlus

# ---- group: run EnergyPlus
# BEO Problem 14
toggle = BooleanToggle(False)

# ---- group: Choose Input folder index
panel = Panel("0")

# ---- group: Replace this with your optimizer
galapagos = Galapagos(
    fitness=prob14gonzalez,
    gene=[number_slider_2, number_slider_3, number_slider_4, number_slider_5, number_slider_6, number_slider_7, number_slider_8, number_slider, number_slider_9, number_slider_10, number_slider_11, number_slider_12, number_slider_13, number_slider_14, number_slider_15, number_slider_16, number_slider_17, number_slider_18, number_slider_19, number_slider_20])

# ---- group: Parameters
number_slider = Slider(1, range=1..4)
number_slider_2 = Slider(0.433255, range=0.021..0.6)
number_slider_3 = Slider(0.3, range=0.3..3)
number_slider_4 = Slider(1.7, range=1.7..5.2)
number_slider_5 = Slider(0.8, range=0.12..0.8)
number_slider_6 = Slider(0.8, range=0.12..0.8)
number_slider_7 = Slider(0.8, range=0.12..0.8)
number_slider_8 = Slider(0.8, range=0.12..0.8)
number_slider_9 = Slider(100, range=100..500)
number_slider_10 = Slider(2.4, range=0.2..2.4)
number_slider_11 = Slider(200, range=200..3000)
number_slider_12 = Slider(0.01, range=0.01..2)
number_slider_13 = Slider(0.01, range=0.01..5)
number_slider_14 = Slider(0.01, range=0.01..5)
number_slider_15 = Slider(0.01, range=0.01..2)
number_slider_16 = Slider(0.01, range=0.01..5)
number_slider_17 = Slider(0.01, range=0.01..5)
number_slider_18 = Slider(0.01, range=0.01..2)
number_slider_19 = Slider(0.01, range=0.01..5)
number_slider_20 = Slider(0.01, range=0.01..5)

# ----
templates_idf = Panel("problem_14_template")
weather_files = Panel("GBR_London.Gatwick.037760_IWEC")
list = ValueList({"LondonGatwick": 0}, selected="LondonGatwick")
item = ListItem(List=templates_idf, Index=list, Wrap=False)
item_2 = ListItem(List=weather_files, Index=list, Wrap=False)
prob14gonzalez = Prob14Gonzalez(
    Idf=item,
    Weather=item_2,
    Run=toggle,
    Folder=panel,
    Infiltration=number_slider_2,
    AspectRatio=number_slider_3,
    UValueWindows=number_slider_4,
    FenestrationNorth=number_slider_5,
    FenestrationSouth=number_slider_6,
    FenestrationEast=number_slider_7,
    FenestrationWest=number_slider_8,
    WallType=number_slider,
    Insulation=number_slider_9,
    Conductivity=number_slider_10,
    X_10=number_slider_11,
    Overhang_S_depth=number_slider_12,
    Overhang_S_left=number_slider_13,
    Overhang_S_right=number_slider_14,
    Overhang_E_depth=number_slider_15,
    Overhang_E_left=number_slider_16,
    Overhang_E_right=number_slider_17,
    Overhang_W_depth=number_slider_18,
    Overhang_W_left=number_slider_19,
    Overhang_W_right=number_slider_20)
f_x = Panel(prob14gonzalez)
