# Grasshopper definition Problem15.gh (Grasshopper 0.9.76)
# plug-ins: GHEnergyPlus

# ---- group: run EnergyPlus
# BEO Problem 15
toggle = BooleanToggle(False)

# ---- group: Choose Input folder index
panel = Panel("0")

# ---- group: Replace this with your optimizer
galapagos = Galapagos(
    fitness=prob15waibel,
    gene=[number_slider, number_slider_2, number_slider_3, number_slider_4, number_slider_5, number_slider_6, number_slider_7, number_slider_8, number_slider_9, number_slider_10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])

# ---- group: integers
number_slider = Slider(1, range=1..6)
number_slider_2 = Slider(1, range=1..6)
number_slider_3 = Slider(1, range=1..6)
number_slider_4 = Slider(1, range=1..6)

# ---- group: real
number_slider_5 = Slider(0.25, range=0..9.5)
number_slider_6 = Slider(5.442, range=0..9.5)
number_slider_7 = Slider(7.318, range=0..9.5)
number_slider_8 = Slider(5.517, range=0..9.5)
number_slider_9 = Slider(9.5, range=0..9.5)
number_slider_10 = Slider(1.83, range=0..9.5)
number_slider_11 = Slider(0, range=0..9.5)
number_slider_12 = Slider(2.056, range=0..9.5)
number_slider_13 = Slider(8.979, range=0..9.5)
number_slider_14 = Slider(0.772, range=0..9.5)
number_slider_15 = Slider(6.044, range=0..9.5)
number_slider_16 = Slider(6.732, range=0..9.5)
number_slider_17 = Slider(0.626, range=0..9.5)
number_slider_18 = Slider(9.5, range=0..9.5)
number_slider_19 = Slider(4.84, range=0..9.5)
number_slider_20 = Slider(6.807, range=0..9.5)
number_slider_21 = Slider(8.828, range=0..9.5)
number_slider_22 = Slider(1.228, range=0..9.5)
number_slider_23 = Slider(6.721, range=0..9.5)
number_slider_24 = Slider(0, range=0..9.5)
number_slider_25 = Slider(0, range=0..9.5)
number_slider_26 = Slider(0, range=0..9.5)
number_slider_27 = Slider(0, range=0..9.5)
number_slider_28 = Slider(5, range=0..5)
number_slider_29 = Slider(0, range=0..9.5)
number_slider_30 = Slider(5, range=0..5)
number_slider_31 = Slider(9.5, range=0..9.5)
number_slider_32 = Slider(9.5, range=0..9.5)
number_slider_33 = Slider(9.5, range=0..9.5)
number_slider_34 = Slider(3.442, range=0..9.5)
number_slider_35 = Slider(7.394, range=0..9.5)

# ----
templates_idf = Panel("Problem15_template")
weather_files = Panel("CH_ZH_original")
list = ValueList({"Zueri": 0}, selected="Zueri")
item = ListItem(List=templates_idf, Index=list, Wrap=False)
item_2 = ListItem(List=weather_files, Index=list, Wrap=False)
prob15waibel = Prob15Waibel(
    Idf=item,
    Weather=item_2,
    Run=toggle,
    Folder=panel,
    BldAfloors=number_slider,
    BldBfloors=number_slider_2,
    BldCfloors=number_slider_3,
    BldDfloors=number_slider_4,
    BldA_X1=number_slider_5,
    BldA_Y1=number_slider_6,
    BldA_X2=number_slider_7,
    BldA_Y2=number_slider_8,
    BldA_X3=number_slider_9,
    BldA_Y3=number_slider_10,
    BldA_X4=number_slider_11,
    BldA_Y4=number_slider_12,
    BldB_X1=number_slider_13,
    BldB_Y1=number_slider_14,
    BldB_X2=number_slider_15,
    BldB_Y2=number_slider_16,
    BldB_X3=number_slider_17,
    BldB_Y3=number_slider_18,
    BldB_X4=number_slider_19,
    BldB_Y4=number_slider_20,
    BldC_X1=number_slider_21,
    BldC_Y1=number_slider_22,
    BldC_X2=number_slider_23,
    BldC_Y2=number_slider_24,
    BldC_X3=number_slider_25,
    BldC_Y3=number_slider_26,
    BldC_X4=number_slider_27,
    BldC_Y4=number_slider_28,
    BldD_X1=number_slider_29,
    BldD_Y1=number_slider_30,
    BldD_X2=number_slider_31,
    BldD_Y2=number_slider_32,
    BldD_X3=number_slider_33,
    BldD_Y3=number_slider_34,
    BldD_X4=number_slider_35)
f_x = Panel(prob15waibel)
