# Grasshopper definition Problem7_discrete.gh (Grasshopper 0.9.76)
# plug-ins: GHEnergyPlus

# ---- group: run EnergyPlus
# BEO Problem 7
toggle = BooleanToggle(False)

# ---- group: Choose Input folder
panel = Panel("0")

# ---- group: Replace with your optimizer
galapagos = Galapagos(
    fitness=wetterdetailedpara,
    gene=[_01_window_n, _02_window_w, _03_overhang_w, _04_window_e, _05_overhang_e, _06_window_s, _07_overhang_s, _08_shading_w, _09_shading_e, _10_shading_s, _11_setpoint_summer, _12_setpoint_winter, _13_setpoint_cooling])

# ---- group: parameters
_11_setpoint_summer = Slider(20, range=0..20)
_13_setpoint_cooling = Slider(24, range=0..24)
_01_window_n = Slider(20, range=0..20)
_02_window_w = Slider(20, range=0..20)
_03_overhang_w = Slider(20, range=0..20)
_04_window_e = Slider(20, range=0..20)
_05_overhang_e = Slider(20, range=0..20)
_06_window_s = Slider(20, range=0..20)
_07_overhang_s = Slider(20, range=0..20)
_08_shading_w = Slider(20, range=0..20)
_09_shading_e = Slider(20, range=0..20)
_10_shading_s = Slider(20, range=0..20)
_12_setpoint_winter = Slider(20, range=0..20)

# ----
templates_idf = Panel("detailed_chicago_template")
weather_files = Panel("USA_IL_Chicago-OHare.725300_TMY2")
expression = Expression(x=_01_window_n, Expression="x*0.05*4.608+1.224")
expression_2 = Expression(x=_02_window_w, Expression="x*0.05*18.324+7.344")
expression_3 = Expression(x=_03_overhang_w, Expression="x*0.05+0.05")
expression_4 = Expression(x=_04_window_e, Expression="x*0.05*18.324+7.344")
expression_5 = Expression(x=_05_overhang_e, Expression="x*0.05+0.05")
expression_6 = Expression(x=_06_window_s, Expression="x*0.05*4.608+1.224")
expression_7 = Expression(x=_07_overhang_s, Expression="x*0.05+0.05")
expression_8 = Expression(x=_08_shading_w, Expression="x*25+100")
expression_9 = Expression(x=_09_shading_e, Expression="x*25+100")
expression_10 = Expression(x=_10_shading_s, Expression="x*25+100")
expression_11 = Expression(x=_11_setpoint_summer, Expression="x*0.25+20")
expression_12 = Expression(x=_12_setpoint_winter, Expression="x*0.25+20")
expression_13 = Expression(x=_13_setpoint_cooling, Expression="x*0.25+12")
list = ValueList({"Chicago": 0}, selected="Chicago")
item = ListItem(List=weather_files, Index=list, Wrap=False)
item_2 = ListItem(List=templates_idf, Index=list, Wrap=False)
wetterdetailedpara = WetterDetailedPara(
    Idf=item_2,
    Weather=item,
    Run=toggle,
    WindowLN=expression,
    WindowLW=expression_2,
    WindowLE=expression_4,
    WindowLS=expression_6,
    OverhangW=expression_3,
    OverhangE=expression_5,
    OverhangS=expression_7,
    ShadingW=expression_8,
    ShadingE=expression_9,
    ShadingS=expression_10,
    SetpointNightSummer=expression_11,
    SetpointNightWinter=expression_12,
    CoolingSupplyTemp=expression_13,
    Folder=panel)
f_x = Panel(wetterdetailedpara)
