# Grasshopper definition Problem8_reduced.gh (Grasshopper 0.9.76)
# plug-ins: GHEnergyPlus

# ---- group: run EnergyPlus
# BEO Problem 8
toggle = BooleanToggle(False)

# ---- group: Choose Input folder index
panel = Panel("0")

# ---- group: Replace this with your optimizer
galapagos = Galapagos(
    fitness=wetterdetailedpara,
    gene=[_01_window_n, _02_window_w, _03_overhang_w, _04_window_e, _05_overhang_e, _06_window_s, _07_overhang_s, _08_shading_w, _09_shading_e, _10_shading_s, _11_setpoint_winter])

# ----
_01_window_n = Slider(0.9998, range=0..1)
_02_window_w = Slider(0.4173, range=0..1)
_05_overhang_e = Slider(0.3031, range=0..1)
_07_overhang_s = Slider(0.3508, range=0..1)
_10_shading_s = Slider(192.4, range=100..600)
_11_setpoint_winter = Slider(23.97, range=20..25)
_03_overhang_w = Slider(0.3537, range=0..1)
_04_window_e = Slider(0.4915, range=0..1)
_06_window_s = Slider(1, range=0..1)
_08_shading_w = Slider(192.9, range=100..600)
_09_shading_e = Slider(180.2, range=100..600)

weather_files = Panel("USA_IL_Chicago-OHare.725300_TMY2")
templates_idf = Panel("detailed_chicago_template")
expression = Expression(x=_02_window_w, Expression="x*18.324+7.344")
expression_2 = Expression(x=_03_overhang_w, Expression="x+0.05")
expression_3 = Expression(x=_04_window_e, Expression="x*18.324+7.344")
expression_4 = Expression(x=_05_overhang_e, Expression="x+0.05")
expression_5 = Expression(x=_01_window_n, Expression="x*4.608+1.224")
expression_6 = Expression(x=_06_window_s, Expression="x*4.608+1.224")
expression_7 = Expression(x=_07_overhang_s, Expression="x+0.05")
num = Number("25")
num_2 = Number("12")
list = ValueList({"Chicago": 0}, selected="Chicago")
item = ListItem(List=weather_files, Index=list, Wrap=False)
item_2 = ListItem(List=templates_idf, Index=list, Wrap=False)
wetterdetailedpara = WetterDetailedPara(
    Idf=item_2,
    Weather=item,
    Run=toggle,
    WindowLN=expression_5,
    WindowLW=expression,
    WindowLE=expression_3,
    WindowLS=expression_6,
    OverhangW=expression_2,
    OverhangE=expression_4,
    OverhangS=expression_7,
    ShadingW=_08_shading_w,
    ShadingE=_09_shading_e,
    ShadingS=_10_shading_s,
    SetpointNightSummer=num,
    SetpointNightWinter=_11_setpoint_winter,
    CoolingSupplyTemp=num_2,
    Folder=panel)
f_x = Panel(wetterdetailedpara)
