# Grasshopper definition Problem9.gh (Grasshopper 0.9.76)
# plug-ins: GHEnergyPlus

# ---- group: run EnergyPlus
# BEO Problem 9
toggle = BooleanToggle(False)

# ---- group: Choose Input folder index
panel = Panel("0")

# ---- group: Replace this with your optimizer
galapagos = Galapagos(
    fitness=prob9kämpf,
    gene=[number_slider, number_slider_3, number_slider_2, number_slider_4, number_slider_5, number_slider_6, number_slider_11, number_slider_7, number_slider_8, number_slider_12, number_slider_13, number_slider_9, number_slider_10])

# ---- group: Parameters
number_slider = Slider(1, range=0.8..1.25)
number_slider_2 = Slider(0.8, range=0.8..1.25)
number_slider_3 = Slider(1.35, range=1.35..2.2)
number_slider_4 = Slider(1.35, range=1.35..2.2)
number_slider_5 = Slider(0.8, range=0.8..1.25)
number_slider_6 = Slider(1.35, range=1.35..2.2)
number_slider_7 = Slider(1.35, range=1.35..2.2)
number_slider_8 = Slider(12, range=12..18)
number_slider_9 = Slider(24, range=24..36)
number_slider_10 = Slider(24, range=24..36)
number_slider_11 = Slider(0.8, range=0.8..1.25)
number_slider_12 = Slider(13, range=13..21)
number_slider_13 = Slider(13, range=13..21)

# ----
templates_idf = Panel("problem_9_template")
weather_files = Panel("USA_CA_San.Francisco.Intl.AP_TMY3")
list = ValueList({"San Francisco": 0}, selected="San Francisco")
item = ListItem(List=weather_files, Index=list, Wrap=False)
item_2 = ListItem(List=templates_idf, Index=list, Wrap=False)
prob9kämpf = Prob9Kämpf(
    Idf=item_2,
    Weather=item,
    Run=toggle,
    Folder=panel,
    N_win_low=number_slider,
    N_win_up=number_slider_3,
    E_win_low=number_slider_2,
    E_win_up=number_slider_4,
    S_win_low=number_slider_5,
    S_win_up=number_slider_6,
    W_win_low=number_slider_11,
    W_win_up=number_slider_7,
    CoolSup=number_slider_8,
    HeatSB_1=number_slider_12,
    HeatSB_2=number_slider_13,
    CoolSB_1=number_slider_9,
    CoolSB_2=number_slider_10)
f_x = Panel(prob9kämpf)
